vi "iSRB.gvi"   [LabVIEW NXG 5.1.0]
panel controls:
  "File Path": path = path "C:\\Users"  # is the complete pathname, including drive, directory, and filename, of the file to read.
  "Parameters": "SRb Params.gtype" = {"UpSampling"=4, "First Visible"=0, "Auto Rotate"=TRUE}
  "Open Image": bool
  "MEASURE": bool
  "Stop": bool
  "Image Button": bool
  "Power Button": bool
panel indicators:
  "Image": "Vision IMAQImage"
  "Interpolation Graph": T1[]
  "resulting string": string
  "resulting string 2": string
  "Line Profile": f32[]
  "Buzy": bool
  "Loaded": bool
  "version": string
types:
  "SRb Params.gtype" = cluster{"UpSampling": i32, "First Visible": u16, "Auto Rotate": bool}
  T1 = cluster{"Element 1": cluster{"Dip": f64, "Dip %": f64}[]}
  T2 = cluster{"ID": enum{"External", "Internal"}, "Type": u32, "Coordinates": i32[]}
  "ROI Descriptor.gtype" = cluster{"Global Rectangle": i32[], "Contours": T2[]}
  T3 = cluster{"Name": string, "Color": u32, "Style": u8, "Point Style": u8, "Name Visible": bool, "Allow Drag": bool, "Cursor Mode": u32, "Plot": i32, "Index": i32, "Position": cluster{"X": f64, "Y": f64}, "X Scale": u32, "Y Scale": u32, "Watch Plots": i32[], "Watch All Plots": bool, "Plot Area": i32, "Label Offset": cluster{"X": f64, "Y": f64}}
uses:
  NI::G Core::File IO (General)::Get System Directory.gvi
  NI::Vision::Core::Basics::Create Image.gvi
  NI::G Core::File IO (General)::File Version Information.gvi
  NI::Vision::Core::Files::Read Image File.gvi
  NI::G Core::Error::Display Error.gvi
  NI::G Core::Operating System::Write to System Log.gvi
  NI::Vision::Core::Overlay::Clear Overlay.gvi
  My Computer::Module SRb - Core.gvi
  NI::Vision::Core::Overlay::Overlay Multiple Lines.gvi
diagram:
  s1 = uninitialised  # shift register
  for (N = 3) (iteration -> i1) {
    case (i1) {
      frame 0, Default {
        call "Get System Directory.gvi"(type="User Desktop") -> (system directory=w2)
        $"File Path" <- w2
        Property Node(instance in=reference to "Image", "ROI"="ROI Descriptor.gtype" {all zero or empty})
        call "Create Image.gvi"(image name="iSRB", image type="Grayscale (U16)"(7)) -> (new image=w1)
        $Loaded <- FALSE
        Get Component Directory() -> (Path=w3)
        Strip Path(path=w3)
        Build Path(base path=w3, name or relative path="iSRB Measurement.exe") -> (appended path=w4)
        call "File Version Information.gvi"(executable or DLL=w4) -> (file version=w5)
        $version <- w5
      }
      frame 1 {
        s2 = s1  # shift register
        while {
          event (timeout = 50) {
            on "Timeout" {
              Property Node(instance in=reference to "Image") -> ("ROI"=w8)
              Property Node(instance in=w8) -> ("Contours"=w9)
              Array Index(array=w9) -> (out0[_]=w10)
              Property Node(instance in=w10) -> ("Type"=w11)
              Is Equal(x=w11, y=12) -> w12
              Logical And($Loaded, w12) -> w13
              Not(x=w13) -> w14
              Property Node(instance in=reference to "MEASURE", "Disabled"=w14)
              w6 = default
              w7 = s2
            }
            on "Stop" Value changed {
              w6 = $Stop
              w7 = s2
            }
            on "Open Image" Value changed {
              call "Read Image File.gvi"(image in=s2, file path=$"File Path") -> (image out=w7, error out=w15)
              $Image <- w7
              call "Display Error.gvi"(error in=w15)
              case (w15) {
                frame Error, Default { }
                frame No Error {
                  $Loaded <- TRUE
                }
              }
              w6 = default
            }
            on "MEASURE" Value changed {
              call "Write to System Log.gvi"(message="MEASURE", severity="Informational"(2))
              $Buzy <- TRUE
              call "Clear Overlay.gvi"(image in=s2) -> (image out=w7)
              Property Node(instance in=reference to "Image") -> ("ROI"=w16)  # Vision Image Display properties
              call "Module SRb - Core.gvi"(Parameters=$Parameters, Image=w7, ROI Descriptor=w16) -> (SRb Graphs=w17, Rectangle Points=w18)
              Property Node(instance in=w17) -> ("Line Profile"=w19)
              $"Line Profile" <- w19
              Property Node(instance in=w17) -> ("Polynom String"=w20, "SRb"=w21, "Interpolation Graph"=w22)
              Property Node(instance in=T3 {all zero or empty}, "Name"="SRB", "Position:X"=w21, "Position:Y"=20, "Plot"=0, "Color"=0, "Style"=8) -> (instance out=w23)
              Build Array(w23) -> w24
              Property Node(instance in=reference to "Interpolation Graph") -> ("Cursor"=w25, instance out=w26)
              Property Node(instance in=w25, "Name"="SRB", "Visible"=TRUE, "XPosition"=w21, "YPosition"=20) -> (instance out=w27)
              sequence (after w26) (after w24) (after w27) {
                frame 0 {
                  # cursors list
                  $Buzy <- FALSE
                }
              }
              Number To Fractional String(number=w21, precision (6)=1) -> (F-format string=w28)
              $"resulting string 2" <- w28
              $"resulting string" <- w20
              $"Interpolation Graph" <- w22
              call "Overlay Multiple Lines.gvi"(color=4294901760, image in=w7, line endpoints=w18) -> (image out=w29)
              $Image <- w29
              w6 = default
            }
            on "Application menu" Menu selection (User) {
              Event Data() -> ("ItemTag"=w30)
              One Button Dialog(message=w30)
              w6 = default
              w7 = s2
            }
          }
          next s2 = w7
          stop if w6
        }
        w1 = s2
      }
      frame 2 {
        w1 = s1
      }
    }
    next s1 = w1
  }
