vi "iSRB.gvi"   [LabVIEW NXG 5.1.0]
panel controls:
  "File Path": path = path "C:\\Users"  # is the complete pathname, including drive, directory, and filename, of the file to read.
  "Open Image": bool
  "MEASURE": bool
  "Stop": bool
  "Open": bool
  "Power Button": bool
  "Measure_2": bool
  "UpSampling": f64 = 4
  "First Visible": u16 = "1D"(0)
  "Auto Rotate": bool = TRUE
panel indicators:
  "Image": "Vision IMAQImage"
  "Interpolation Graph": T1[]
  "resulting string": string
  "resulting string 2": string
  "Line Profile": f32[]
  "Buzy": bool
  "Loaded": bool
  "version": string
types:
  T1 = cluster{"Element 1": cluster{"Dip": f64, "Dip %": f64}[]}
  T2 = cluster{"ID": enum{"External", "Internal"}, "Type": u32, "Coordinates": i32[]}
  "ROI Descriptor.gtype" = cluster{"Global Rectangle": i32[], "Contours": T2[]}
  T3 = cluster{"Name": string, "Color": u32, "Style": u8, "Point Style": u8, "Name Visible": bool, "Allow Drag": bool, "Cursor Mode": u32, "Plot": i32, "Index": i32, "Position": cluster{"X": f64, "Y": f64}, "X Scale": u32, "Y Scale": u32, "Watch Plots": i32[], "Watch All Plots": bool, "Plot Area": i32, "Label Offset": cluster{"X": f64, "Y": f64}}
uses:
  NI::G Core::File IO (General)::Get System Directory.gvi
  NI::G Core::File IO (General)::File Version Information.gvi
  NI::Vision::Core::Basics::Create Image.gvi
  NI::Vision::Core::Files::Read Image File.gvi
  NI::G Core::Error::Display Error.gvi
  NI::G Core::Operating System::Write to System Log.gvi
  NI::Vision::Core::Overlay::Clear Overlay.gvi
  My Computer::Module SRb - Core.gvi
  NI::Vision::Core::Overlay::Overlay Multiple Lines.gvi
  NI::Vision::Core::Files::Load Image Dialog.gvi
diagram:
  s1 = uninitialised  # shift register
  for (N = 3) (iteration -> i1) {
    case (i1) {
      frame 0, Default {
        call "Get System Directory.gvi"(type="User Desktop") -> (system directory=w2)
        $"File Path" <- w2
        Property Node(instance in=reference to "Image", "ROI"="ROI Descriptor.gtype" {all zero or empty})
        $"resulting string" <- ""
        $Loaded <- FALSE
        Get Component Directory() -> (Path=w3)
        Build Path(base path=w3, name or relative path="iSRB Measurement.exe") -> (appended path=w4)
        call "File Version Information.gvi"(executable or DLL=w4) -> (file version=w5, error out=w6)
        case (w6) {
          frame Error, Default {
            w7 = "Dev"
          }
          frame No Error {
            w7 = w5
          }
        }
        Concatenate Strings("iSRB Measurement Tool - ", w7) -> w8
        call "Create Image.gvi"(image name="iSRB", image type="Grayscale (U16)"(7)) -> (new image=w9)
        Build Cluster(w9, $"File Path", w8) -> w1
        Strip Path(path=w3)
        $version <- w7
        Property Node(instance in=reference to unnamed native front panel) -> ("Window"=w10)
        Property Node(instance in=w10, "Title"=w8)
      }
      frame 1 {
        s2 = s1  # shift register
        while {
          event (timeout = 50) {
            on "Timeout" {
              Property Node(instance in=reference to "Image") -> ("ROI"=w13)
              Property Node(instance in=w13) -> ("Contours"=w14)
              Array Index(array=w14) -> (out0[_]=w15)
              Property Node(instance in=w15) -> ("Type"=w16)
              Is Equal(x=w16, y=12) -> w17
              Logical And($Loaded, w17) -> w18
              Not(x=w18) -> w19
              Property Node(instance in=reference to "MEASURE", "Disabled"=w19)
              w11 = default
              w12 = s2
            }
            on "Stop" Value changed {
              w11 = $Stop
              w12 = s2
            }
            on "Open Image" Value changed {
              Property Node(instance in=s2) -> ("Element 1"=w20, "Element 2"=w21, instance out=w22)
              call "Read Image File.gvi"(image in=w20, file path=w21) -> (image out=w23, error out=w24)
              Property Node(instance in=w22, "Element 1"=w23) -> (instance out=w12)
              $Image <- w23
              case (w24) {
                frame Error, Default {
                  call "Display Error.gvi"(error in=w24)
                }
                frame No Error {
                  $Loaded <- TRUE
                }
              }
              w11 = default
            }
            on "MEASURE" Value changed {
              call "Write to System Log.gvi"(message="MEASURE", severity="Informational"(2))
              $Buzy <- TRUE
              Property Node(instance in=reference to "Image") -> ("ROI"=w25)  # Vision Image Display properties
              Property Node(instance in=s2) -> ("Element 1"=w26, instance out=w12)
              call "Clear Overlay.gvi"(image in=w26) -> (image out=w27)
              Build Cluster($UpSampling, $"First Visible", $"Auto Rotate") -> w28
              call "Module SRb - Core.gvi"(Parameters=w28, Image=w27, ROI Descriptor=w25) -> (SRb Graphs=w29, Rectangle Points=w30)
              Property Node(instance in=w29) -> ("Line Profile"=w31)
              $"Line Profile" <- w31
              Property Node(instance in=w29) -> ("Polynom String"=w32, "SRb"=w33, "Interpolation Graph"=w34)
              Property Node(instance in=T3 {all zero or empty}, "Name"="SRB", "Position:X"=w33, "Position:Y"=20, "Plot"=0, "Color"=0, "Style"=8) -> (instance out=w35)
              Build Array(w35) -> w36
              Property Node(instance in=reference to "Interpolation Graph") -> ("Cursor"=w37, instance out=w38)
              Property Node(instance in=w37, "Name"="SRB", "Visible"=TRUE, "XPosition"=w33, "YPosition"=20) -> (instance out=w39)
              sequence (after w38) (after w36) (after w39) {
                frame 0 {
                  # cursors list
                  $Buzy <- FALSE
                }
              }
              Number To Fractional String(number=w33, precision (6)=1) -> (F-format string=w40)
              $"resulting string 2" <- w40
              $"resulting string" <- w32
              $"Interpolation Graph" <- w34
              call "Overlay Multiple Lines.gvi"(color=4294901760, image in=w27, line endpoints=w30) -> (image out=w41)
              $Image <- w41
              w11 = default
            }
            on "Application menu" Menu selection (User) {
              Event Data() -> ("ItemTag"=w42)
              case (w42) {
                frame Default {
                  One Button Dialog(message=w42)
                  w12 = s2
                }
                frame "_Open..." {
                  Property Node(instance in=s2) -> ("Element 1"=w43, instance out=w44)
                  call "Get System Directory.gvi"(type="User Desktop") -> (system directory=w45)
                  call "Load Image Dialog.gvi"(start path=w45) -> (selected path=w46, cancelled?=w47)
                  case (w47) {
                    frame True {
                      # cancelled...
                      w12 = w44
                    }
                    frame False {
                      call "Read Image File.gvi"(image in=w43, file path=w46) -> (image out=w48, error out=w49)
                      Property Node(instance in=w44, "Element 1"=w48) -> (instance out=w12)
                      Property Node(instance in=w44) -> ("Element 3"=w50)
                      Path To String(path=w46) -> (string=w51)
                      Concatenate Strings(w50, " - ", w51) -> w52
                      Property Node(instance in=reference to unnamed native front panel) -> ("Window"=w53)
                      Property Node(instance in=w53, "Title"=w52)
                      $Image <- w48
                      case (w49) {
                        frame Error, Default {
                          call "Display Error.gvi"(error in=w49)
                        }
                        frame No Error {
                          $Loaded <- TRUE
                        }
                      }
                    }
                  }
                }
              }
              w11 = default
            }
          }
          next s2 = w12
          stop if w11
        }
        w1 = s2
      }
      frame 2 {
        w1 = s1
      }
    }
    next s1 = w1
  }
